# Grasshopper definition multi-drone-construction.gh (Grasshopper 1.0.4)
# plug-ins: Weaverbird

rectangle = Rectangle(Plane=PlaneXY(0, 0, 0), XSize=Domain(-10, 10), YSize=Domain(-10, 10), Radius=0)  # -> Rectangle, Length

# ----
# Record reader
path = FilePath("F:\Works\thesis\code\src\vis\stream\facadecoating")
file = ReadFile(File=path, PerLineParse=True)
lng = ListLength(List=file)
subtraction = Subtraction(A=lng, B=1)
multiplication = Multiplication(A=Slider(0, range=0..1), B=subtraction)
int = Integer(multiplication)
item = ListItem(List=file, Index=int, Wrap=True)

# ----
# Web socket
panel = Panel("ws://127.0.0.1:8765")
websocket_client_start = WebsocketClientStart(Address=panel, InitalMessage="grasshopper", Reset=Toggle(False))
websocket_client_sender = WebsocketClientSender(WebsocketObjects=websocket_client_start, Message="Hello World")
websocket_client_receiver = WebsocketClientReceiver(WebsocketObjects=websocket_client_start, AutoUpdate=True)  # -> Message, Status

crv = Curve(rectangle.Rectangle)
data = Data(websocket_client_receiver.Message)

python = GhPythonScript(x=data)  # -> drone_pos, drone_rot, drone_battery, brick_trans_pos, brick_trans_rot, brick_trans_type, brick_built_pos, brick_built_rot, brick_built_type
# ---------- python: Python ----------
import json
import clr


d = json.loads(x)
agents = d['agents']
drone_pos = [str(i['p_pos'])[1:-1] for i in agents]
drone_rot = [str(i['p_rot']) for i in agents]
drone_battery = [str(i['battery']) for i in agents]
brick_trans = d['bricks']['transport']
brick_trans_pos = [str(i['p_pos'])[1:-1] for i in brick_trans]
brick_trans_rot = [str(i['p_rot']) for i in brick_trans]
brick_trans_type = [str(i['type']) for i in brick_trans]
brick_built = d['bricks']['built']
brick_built_pos = [str(i['p_pos'])[1:-1] for i in brick_built]
brick_built_rot = [str(i['p_rot']) for i in brick_built]
brick_built_type = [str(i['type']) for i in brick_built]
# ---------- end python ----------
box = CenterBox(Base=PlaneXY(0, 0, 0), X=Slider(0.3, range=0..1), Y=Slider(0.15, range=0..1), Z=Slider(0.08, range=0..1))
mesh = Mesh(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)
cluster = Cluster(pt=python.drone_pos, A=python.drone_rot, G=mesh)
cluster_2 = Cluster(pt=python.brick_built_pos, A=python.brick_built_rot, G=box)
cluster_3 = Cluster(pt=python.brick_trans_pos, A=python.brick_trans_rot, G=box)
dispatch = Dispatch(List=cluster_3, DispatchPattern=python.brick_trans_type)  # -> ListA, ListB
dispatch_2 = Dispatch(List=cluster_2, DispatchPattern=python.brick_built_type)  # -> ListA, ListB
mesh_2 = Mesh(cluster)
preview = CustomPreview(
    Geometry=[dispatch.ListB, dispatch_2.ListB],
    Material={diffuse=RGB(192, 192, 192), emission=RGB(76, 76, 76), shine=0, specular=RGB(255, 255, 255), transparency=0.2})
preview_2 = CustomPreview(
    Geometry=[dispatch.ListA, dispatch_2.ListA],
    Material={diffuse=RGB(105, 105, 105), emission=RGB(76, 76, 76), shine=0, specular=RGB(255, 255, 255), transparency=0.2})

# ----
# Brick laying
pt = Point([Point(-4.8, 8, 0), Point(-2.390171754, 6.994969335, 0), Point(2.390171754, 9.005030665, 0), Point(4.8, 8, 0)])
number_slider = Slider(0.08, range=0..1)
nurbs = NurbsCurve(Vertices=pt, Degree=3, Periodic=False)  # -> Curve, Length, Domain
box_2 = CenterBox(Base=PlaneXY(0, 0, 0), X=Slider(0.3, range=0..1), Y=Slider(0.15, range=0..1), Z=number_slider)
Z = UnitZ(Factor=Slider(1.4, range=0..10))
move = Move(Geometry=nurbs.Curve, Motion=Z)  # -> Geometry, Transform
reb = RebuildCurve(Curve=[nurbs.Curve, move.Geometry], Degree=20, Count=10, Tangents=False)
loft = Loft(Curves=reb, Options={Adjust=False, Closed=False, LoftEnds=0, LoftSimp=0, LoftType=0, Rebuild=10, Refit=0.01})
Z_2 = UnitZ(Factor=number_slider)
contour = Contour(Shape=loft, Point=Point(0, 0, 0), Direction=Vector(0, 0, 1), Distance=Slider(0.17, range=0..2))
hframes = HorizontalFrames(Curve=contour, Count=Slider(16, range=0..50))  # -> Frames, Parameters
move_2 = Move(Geometry=hframes.Frames, Motion=Z_2)  # -> Geometry, Transform
orient = Orient(Geometry=box_2, Source=PlaneXY(0, 0, 0), Target=move_2.Geometry)  # -> Geometry, Transform
lng_2 = ListLength(List=flatten(orient.Geometry))
int_2 = Integer([32, 49, 66, 83, 100, 117, 134, 116, 99, 82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])
preview_3 = CustomPreview(
    Geometry=orient.Geometry,
    Material={diffuse=RGB(169, 169, 169), emission=RGB(255, 255, 255), shine=0, specular=RGB(255, 255, 255), transparency=0.5})
lng_3 = ListLength(List=flatten(int_2))
repeat = RepeatData(Data=1, Length=lng_3)  # -> flatten(Data)
repeat_2 = RepeatData(Data=0, Length=lng_2)
replace = ReplaceItems(List=repeat_2, Item=repeat, Indices=int_2, Wrap=False)
cull_i = CullIndex(List=flatten(orient.Geometry), Indices=int_2, Wrap=False)
item_2 = ListItem(List=flatten(orient.Geometry), Index=int_2, Wrap=False)
unflatten = UnflattenTree(Tree=replace, Guide=orient.Geometry)
preview_4 = CustomPreview(
    Geometry=item_2,
    Material={diffuse=RGB(105, 105, 105), emission=RGB(76, 76, 76), shine=0, specular=RGB(255, 255, 255), transparency=0.2})
preview_5 = CustomPreview(
    Geometry=cull_i,
    Material={diffuse=RGB(192, 192, 192), emission=RGB(76, 76, 76), shine=0, specular=RGB(255, 255, 255), transparency=0.2})

pt_2 = Point(Point(0, 1, 0))
number_slider_2 = Slider(40, range=0..100)
# Facade coating
xz = XZPlane(Origin=pt_2)
number_slider_3 = Slider(10, range=0..100)
pflip = FlipPlane(Plane=xz, ReverseX=True, ReverseY=False, SwapAxes=False)
msphere = MeshSphere(
    Base=pflip,
    Radius=Slider(3, range=0..10),
    UCount=[number_slider_2, number_slider_3],
    VCount=[number_slider_2, number_slider_3])
facen = FaceNormals(Mesh=msphere)  # -> Centers, Normals
pdecon = Deconstruct(Point=pt_2)  # -> XComponent, YComponent, ZComponent
pdecon_2 = Deconstruct(Point=facen.Centers)  # -> XComponent, YComponent, ZComponent
subtraction_2 = Subtraction(A=pdecon_2.YComponent, B=pdecon.YComponent)
smaller = SmallerThan(FirstNumber=pdecon_2.ZComponent, SecondNumber=0)  # -> SmallerThan, OrEqualTo
abs = Absolute(Value=subtraction_2)
larger = LargerThan(FirstNumber=abs, SecondNumber=Slider(2.3, range=0..10))  # -> LargerThan, OrEqualTo
or = GateOr(A=smaller.SmallerThan, B=larger.LargerThan)
cullf = CullFaces(Mesh=graft(msphere), Pattern=or)  # -> flatten(Mesh)
item_3 = ListItem(List=cullf, Index=Slider(1, range=0..10), Wrap=True)
item_4 = ListItem(List=cullf, Index=0, Wrap=True)
wboffset = WeaverbirdsOffsetMesh(MeshCurves=item_3, Distance=Slider(1.4, range=0..2), OffsetType=0)
neg = Negative(Value=Slider(0.1, range=0..1))
Y = UnitY(Factor=1)
faceb = FaceBoundaries(Mesh=wboffset)
wboffset_2 = WeaverbirdsOffsetMesh(MeshCurves=item_4, Distance=neg, OffsetType=0)
facen_2 = FaceNormals(Mesh=wboffset)  # -> Centers, Normals
rev = Reverse(Vector=facen_2.Normals)
vdis = VectorDisplay(Anchor=facen_2.Centers, Vector=rev)
devec = DeconstructVector(Vector=rev)  # -> XComponent, YComponent, ZComponent
larger_2 = LargerThan(FirstNumber=devec.XComponent, SecondNumber=0)  # -> LargerThan, OrEqualTo
multiplication_2 = Multiplication(A=-2, B=larger_2.LargerThan)
vec = VectorXYZ(XComponent=devec.XComponent, YComponent=devec.YComponent, ZComponent=0)  # -> Vector, Length
angle = Angle(VectorA=Y, VectorB=vec.Vector)  # -> Angle, Reflex
addition = Addition(A=multiplication_2, B=1)
facen_3 = FaceNormals(Mesh=item_4)  # -> Centers, Normals
faceb_2 = FaceBoundaries(Mesh=item_4)
faceb_3 = FaceBoundaries(Mesh=wboffset_2)
panel_2 = Panel(facen_2.Centers)
multiplication_3 = Multiplication(A=angle.Angle, B=addition)
cpoly = ControlPolygon(Curve=faceb_3)  # -> Polygon, Points
cpoly_2 = ControlPolygon(Curve=faceb_2)  # -> Polygon, Points
cp = ClosestPoint(Point=graft(facen_3.Centers), Cloud=facen_2.Centers)  # -> flatten(ClosestPoint), CPIndex, Distance
cset = CreateSet(List=cpoly.Points)  # -> Set, Map
cset_2 = CreateSet(List=cpoly_2.Points)  # -> Set, Map
unflatten_2 = UnflattenTree(Tree=multiplication_3, Guide=rev)
pi = Pi(Factor=2)
addition_2 = Addition(A=unflatten_2, B=pi)
weave = Weave(Pattern=[0, 0, 0, 0, 1, 1, 1, 1], Stream0=cset_2.Set, Stream1=cset.Set, NullGaps=False)  # -> simplify(Weave)
python_2 = GhPythonScript(spray_pos=facen_2.Centers, spray_poses=cp.ClosestPoint)  # -> out, spray_brick_indices; inputs spray_pos: list of Point3d, spray_poses: list of Point3d
# ---------- python_2: Python ----------
from clr import AddReference as addr
addr("Grasshopper")

from System import Object
from Grasshopper import DataTree
from Grasshopper.Kernel.Data import GH_Path


def raggedListToDataTree(raggedList):
    rl = raggedList
    result = DataTree[object]()
    for i in range(len(rl)):
        temp = []
        for j in range(len(rl[i])):
            temp.append(rl[i][j])
        path = GH_Path(i)
        result.AddRange(temp, path)
    return result


spray_brick_indices = [[] for i in range(len(spray_pos))]
for i, pos in enumerate(spray_poses):
    spray_brick_indices[spray_pos.index(pos)].append(i)
    
    

print(spray_brick_indices)

out = raggedListToDataTree(spray_brick_indices)
# ---------- end python_2 ----------
mod = Modulus(A=addition_2, B=pi)
conmesh = ConstructMesh(Vertices=weave, Faces=[{A=0, B=1, C=2, D=3}, {A=7, B=6, C=5, D=4}])  # -> flatten(Mesh)
item_5 = ListItem(List=graft(facen_3.Centers), Index=python_2.out, Wrap=True)
panel_3 = Panel(python_2.out)
ln = Line(StartPoint=item_5, EndPoint=graft(cp.ClosestPoint))
panel_4 = Panel(mod)
conmesh_2 = ConstructMesh(
    Vertices=weave,
    Faces=[{A=4, B=5, C=1, D=0}, {A=5, B=6, C=2, D=1}, {A=6, B=7, C=3, D=2}, {A=0, B=3, C=7, D=4}, {A=0, B=1, C=2, D=3}, {A=7, B=6, C=5, D=4}])  # -> flatten(Mesh)

max_trail_points = Slider(8, range=0..20)
pt_3 = Point(graft(python.drone_pos))
rec = DataRecorder(pt_3, DataLimit=20, RecordData=True)
rev_2 = ReverseList(List=rec)
dom = ConstructDomain(DomainStart=0, DomainEnd=max_trail_points)
subset = SubList(List=rev_2, Domain=dom, Wrap=True)  # -> List, Index
intcrv = Interpolate(Vertices=subset.List, Degree=5, Periodic=False, KnotStyle=1)  # -> Curve, Length, Domain
preview_6 = CustomPreview(
    Geometry=intcrv.Curve,
    Material={diffuse=RGB(205, 92, 92), emission=RGB(76, 76, 76), shine=0.5, specular=RGB(255, 255, 255), transparency=0.5})

Z_3 = UnitZ(Factor=Slider(0.155, range=0..1))
move_3 = Move(Geometry=python.drone_pos, Motion=Z_3)  # -> Geometry, Transform
division = Division(A=python.drone_battery, B=100)
pi_2 = Pi(Factor=2)
multiplication_4 = Multiplication(A=division, B=pi_2)
pflip_2 = FlipPlane(Plane=move_3.Geometry, ReverseX=True, ReverseY=False, SwapAxes=True)
arc = Arc(Plane=pflip_2, Radius=Slider(0.2, range=0..1), Angle=multiplication_4)  # -> graft(Arc), Length
offset = OffsetCurve(Curve=arc.Arc, Distance=0.03, Plane=PlaneXY(0, 0, 0), Corners=1)
crv_2 = Curve(arc.Arc)
larger_3 = LargerThan(FirstNumber=division, SecondNumber=0.3)  # -> LargerThan, OrEqualTo
weave_2 = Weave(Pattern=[0, 1], Stream0=crv_2, Stream1=offset, NullGaps=False)
loft_2 = Loft(Curves=weave_2, Options={Adjust=False, Closed=False, LoftEnds=0, LoftSimp=0, LoftType=0, Rebuild=10, Refit=0.01})  # -> flatten(Loft)
dispatch_3 = Dispatch(List=loft_2, DispatchPattern=larger_3.LargerThan)  # -> ListA, ListB
preview_7 = CustomPreview(
    Geometry=dispatch_3.ListA,
    Material={diffuse=RGB(46, 139, 87), emission=RGB(76, 76, 76), shine=0.5, specular=RGB(255, 255, 255), transparency=0})
preview_8 = CustomPreview(
    Geometry=dispatch_3.ListB,
    Material={diffuse=RGB(184, 134, 11), emission=RGB(76, 76, 76), shine=0.5, specular=RGB(255, 255, 255), transparency=0})

deplane = DeconstructPlane(Plane=move_2.Geometry)  # -> Origin, XAxis, YAxis, ZAxis
vec_2 = Vector(deplane.XAxis)
devec_2 = DeconstructVector(Vector=vec_2)  # -> simplify(graft(XComponent)), simplify(graft(YComponent)), ZComponent
pt_4 = Point(deplane.Origin)
division_2 = Division(A=devec_2.YComponent, B=devec_2.XComponent)
panel_5 = Panel(deplane.Origin)
atan = ArcTangent(Value=division_2)
unflatten_3 = UnflattenTree(Tree=atan, Guide=vec_2)
pi_3 = Pi(Factor=2)
points = PointList(Points=flatten(panel_5), Size=0.07)
addition_3 = Addition(A=unflatten_3, B=pi_3)
mod_2 = Modulus(A=addition_3, B=pi_3)
python_3 = GhPythonScript(x=panel_5)  # -> a; inputs x: tree
# ---------- python_3: Python ----------
import json

a = []

for i in range(x.BranchCount):
    branchList = x.Branch(i)
    branchPath = x.Path(i)
    _a = []
    for j in range(branchList.Count):
        s = str(branchList[j])[1:-1]
        _a.append([float(_s.replace(",","")) for _s in s.split()])
    a.append(_a)
a = json.dumps(a)
# ---------- end python_3 ----------
python_4 = GhPythonScript(x=mod_2)  # -> a; inputs x: tree
# ---------- python_4: Python ----------
import json
a = []

for i in range(x.BranchCount):
    branchList = x.Branch(i)
    branchPath = x.Path(i)
    _a = []
    for j in range(branchList.Count):
#        s = str(branchPath) + "[" + str(j) + "] "
#        s += type(branchList[j]).__name__ + ": "
        s = str(branchList[j])
        _a.append(float(s))
    a.append(_a)
a = json.dumps(a)
# ---------- end python_4 ----------
python_5 = GhPythonScript(x=unflatten)  # -> a; inputs x: tree
# ---------- python_5: Python ----------
import json
a = []

for i in range(x.BranchCount):
    branchList = x.Branch(i)
    branchPath = x.Path(i)
    _a = []
    for j in range(branchList.Count):
        s = str(branchList[j])
        _a.append(int(s))
    a.append(_a)
a = json.dumps(a)
# ---------- end python_5 ----------

python_6 = GhPythonScript(x=data)  # -> drone_pos, drone_rot, drone_battery, spray_progress, spray_operating
# ---------- python_6: Python ----------
import json
import clr


d = json.loads(x)
agents = d['agents']
drone_pos = [str(i['p_pos'])[1:-1] for i in agents]
drone_rot = [str(i['p_rot']) for i in agents]
drone_battery = [str(i['battery']) for i in agents]

sprays = d['sprays']
spray_progress = sprays['progress']
spray_operating = sprays['operating']
# ---------- end python_6 ----------
mesh_3 = Mesh(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)
hsv = ColourHSV(Alpha=1, Hue=0.5, Saturation=python_6.spray_progress, Value=1)
panel_6 = Panel(python_6.spray_progress)
cluster_4 = Cluster(pt=python_6.drone_pos, A=python_6.drone_rot, G=mesh_3)
material = CreateMaterial(Diffuse=hsv, Specular=RGB(255, 255, 255), Emission=RGB(0, 0, 0), Transparency=0.2, Shine=0)
cset_3 = CreateSet(List=cp.ClosestPoint)  # -> Set, Map
panel_7 = Panel(python_6.spray_operating)
mesh_4 = Mesh(cluster_4)
item_6 = ListItem(List=material, Index=cset_3.Map, Wrap=True)
preview_9 = CustomPreview(Geometry=conmesh, Material=flatten(item_6))
pt_5 = Point(facen_2.Centers)
lng_4 = ListLength(List=pt_5)
pt_6 = Point(facen_3.Centers)
int_3 = Integer(python_2.out)
series = Series(Start=0, Step=1, Count=lng_4)
hsv_2 = ColourHSV(Alpha=1, Hue=0.5, Saturation=1, Value=1)
faceb_4 = FaceBoundaries(Mesh=conmesh_2)
dispatch_4 = Dispatch(List=series, DispatchPattern=python_6.spray_operating)  # -> ListA, ListB
dispatch_5 = Dispatch(List=pt_5, DispatchPattern=python_6.spray_operating)  # -> simplify(graft(ListA)), ListB
item_7 = ListItem(List=pt_6, Index=int_3, Wrap=True)
branch = TreeBranch(Tree=item_7, Path=dispatch_4.ListA, MaintainPaths=True)
preview_10 = CustomPreview(
    Geometry=faceb_4,
    Material={diffuse=RGB(128, 128, 128), emission=RGB(128, 128, 128), shine=0.5, specular=RGB(255, 255, 255), transparency=0.5})
ln_2 = Line(StartPoint=dispatch_5.ListA, EndPoint=branch)
preview_11 = CustomPreview(Geometry=ln_2, Material=hsv_2)
viewer = ParamViewer(branch)
panel_8 = Panel(item_7)

max_trail_points_2 = Slider(8, range=0..20)
pt_7 = Point(graft(python_6.drone_pos))
rec_2 = DataRecorder(pt_7, DataLimit=20, RecordData=True)
rev_3 = ReverseList(List=rec_2)
dom_2 = ConstructDomain(DomainStart=0, DomainEnd=max_trail_points_2)
subset_2 = SubList(List=rev_3, Domain=dom_2, Wrap=True)  # -> List, Index
intcrv_2 = Interpolate(Vertices=subset_2.List, Degree=5, Periodic=False, KnotStyle=1)  # -> Curve, Length, Domain
preview_12 = CustomPreview(
    Geometry=intcrv_2.Curve,
    Material={diffuse=RGB(205, 92, 92), emission=RGB(76, 76, 76), shine=0.5, specular=RGB(255, 255, 255), transparency=0.5})

Z_4 = UnitZ(Factor=Slider(0.155, range=0..1))
move_4 = Move(Geometry=python_6.drone_pos, Motion=Z_4)  # -> Geometry, Transform
division_3 = Division(A=python_6.drone_battery, B=100)
pi_4 = Pi(Factor=2)
multiplication_5 = Multiplication(A=division_3, B=pi_4)
pflip_3 = FlipPlane(Plane=move_4.Geometry, ReverseX=True, ReverseY=False, SwapAxes=True)
arc_2 = Arc(Plane=pflip_3, Radius=Slider(0.2, range=0..1), Angle=multiplication_5)  # -> graft(Arc), Length
offset_2 = OffsetCurve(Curve=arc_2.Arc, Distance=0.03, Plane=PlaneXY(0, 0, 0), Corners=1)
crv_3 = Curve(arc_2.Arc)
larger_4 = LargerThan(FirstNumber=division_3, SecondNumber=0.3)  # -> LargerThan, OrEqualTo
weave_3 = Weave(Pattern=[0, 1], Stream0=crv_3, Stream1=offset_2, NullGaps=False)
loft_3 = Loft(Curves=weave_3, Options={Adjust=False, Closed=False, LoftEnds=0, LoftSimp=0, LoftType=0, Rebuild=10, Refit=0.01})  # -> flatten(Loft)
dispatch_6 = Dispatch(List=loft_3, DispatchPattern=larger_4.LargerThan)  # -> ListA, ListB
preview_13 = CustomPreview(
    Geometry=dispatch_6.ListA,
    Material={diffuse=RGB(46, 139, 87), emission=RGB(76, 76, 76), shine=0.5, specular=RGB(255, 255, 255), transparency=0})
preview_14 = CustomPreview(
    Geometry=dispatch_6.ListB,
    Material={diffuse=RGB(184, 134, 11), emission=RGB(76, 76, 76), shine=0.5, specular=RGB(255, 255, 255), transparency=0})

# ----
# Drones
# Drone number
number_slider_4 = Slider(8, range=0..20)
number_slider_5 = Slider(8, range=1..10)
number_slider_6 = Slider(-9, range=-10..0)
series_2 = Series(Start=number_slider_6, Step=1.5, Count=number_slider_5)
series_3 = Series(Start=number_slider_6, Step=1.5, Count=number_slider_5)
vec_3 = VectorXYZ(XComponent=-8, YComponent=series_2, ZComponent=1.5)  # -> Vector, Length
pi_5 = Pi(Factor=0.5)
pi_6 = Pi(Factor=1.5)
vec_4 = VectorXYZ(XComponent=8, YComponent=series_3, ZComponent=1.5)  # -> Vector, Length
deplane_2 = DeconstructPlane(Plane=vec_3.Vector)  # -> Origin, XAxis, YAxis, ZAxis
deplane_3 = DeconstructPlane(Plane=vec_4.Vector)  # -> Origin, XAxis, YAxis, ZAxis
repeat_3 = RepeatData(Data=[pi_5, pi_6], Length=number_slider_4)
weave_4 = Weave(Pattern=[0, 1], Stream0=deplane_3.Origin, Stream1=deplane_2.Origin, NullGaps=False)
split = SplitList(List=weave_4, Index=number_slider_4)  # -> ListA, ListB
devec_3 = DeconstructVector(Vector=split.ListA)  # -> XComponent, YComponent, ZComponent
neg_2 = Negative(Value=devec_3.ZComponent)
panel_9 = Panel(split.ListA)
cyl = Cylinder(Base=split.ListA, Radius=Slider(0.087, range=0..1), Length=neg_2)
box_3 = CenterBox(Base=split.ListA, X=Slider(0.4, range=0..1), Y=Slider(0.4, range=0..1), Z=Slider(0.05, range=0..1))

# ----
# Supply stations
number_slider_7 = Slider(1, range=0..10)
number_slider_8 = Slider(2.5, range=0..10)
md_slider = MDSlider(
    slider_value=Point(0.4995600103, 0.09716723801, 0.5),
    SliderMode=0,
    x_domain=Domain(-10, 10),
    y_domain=Domain(-10, 10),
    z_domain=Domain(0, 1))
devec_4 = DeconstructVector(Vector=md_slider)  # -> XComponent, YComponent, ZComponent
neg_3 = Negative(Value=number_slider_8)
addition_4 = Addition(A=neg_3, B=devec_4.XComponent)
addition_5 = Addition(A=number_slider_8, B=devec_4.XComponent)
vec_5 = VectorXYZ(XComponent=addition_4, YComponent=devec_4.YComponent, ZComponent=1)  # -> Vector, Length
vec_6 = VectorXYZ(XComponent=addition_5, YComponent=devec_4.YComponent, ZComponent=1)  # -> Vector, Length
ln_3 = Line(StartPoint=vec_5.Vector, EndPoint=vec_6.Vector)
divide = DivideCurve(Curve=ln_3, Count=number_slider_7, Kinks=False)  # -> Points, Tangents, Parameters
cset_4 = CreateSet(List=divide.Points)  # -> Set, Map
lng_5 = ListLength(List=cset_4.Set)
int_4 = Integer(0)
int_5 = Integer(1)
num = Number(0)
devec_5 = DeconstructVector(Vector=cset_4.Set)  # -> XComponent, YComponent, ZComponent
repeat_4 = RepeatData(Data=[int_4, int_5], Length=lng_5)
panel_10 = Panel(cset_4.Set)
repeat_5 = RepeatData(Data=num, Length=lng_5)
neg_4 = Negative(Value=devec_5.ZComponent)
move_5 = Move(Geometry=box_2, Motion=cset_4.Set)  # -> Geometry, Transform
cyl_2 = Cylinder(Base=cset_4.Set, Radius=Slider(0.7, range=0..1), Length=neg_4)
cap = CapHoles(Brep=cyl_2)
dispatch_7 = Dispatch(List=move_5.Geometry, DispatchPattern=[True, False])  # -> ListA, ListB
preview_15 = CustomPreview(
    Geometry=dispatch_7.ListA,
    Material={diffuse=RGB(192, 192, 192), emission=RGB(76, 76, 76), shine=0, specular=RGB(255, 255, 255), transparency=0.2})
preview_16 = CustomPreview(
    Geometry=dispatch_7.ListB,
    Material={diffuse=RGB(105, 105, 105), emission=RGB(76, 76, 76), shine=0, specular=RGB(255, 255, 255), transparency=0.2})

# ----
# Threats
md_slider_2 = MDSlider(
    slider_value=Point(0.750016276, 0.2462088048, 0.5),
    SliderMode=0,
    x_domain=Domain(-10, 10),
    y_domain=Domain(-10, 10),
    z_domain=Domain(0, 1))
md_slider_3 = MDSlider(
    slider_value=Point(0.7487087674, 0.7519740581, 0.5),
    SliderMode=0,
    x_domain=Domain(-10, 10),
    y_domain=Domain(-10, 10),
    z_domain=Domain(0, 1))
md_slider_4 = MDSlider(
    slider_value=Point(0.2498182509, 0.2470983746, 0.5),
    SliderMode=0,
    x_domain=Domain(-10, 10),
    y_domain=Domain(-10, 10),
    z_domain=Domain(0, 1))
md_slider_5 = MDSlider(
    slider_value=Point(0.2496700077, 0.7507483371, 0.5),
    SliderMode=0,
    x_domain=Domain(-10, 10),
    y_domain=Domain(-10, 10),
    z_domain=Domain(0, 1))
num_2 = Number([Slider(0.4, range=0..1), Slider(0.4, range=0..1), Slider(0.4, range=0..1), Slider(0.4, range=0..1)])
pt_8 = Point([md_slider_5, md_slider_3, md_slider_4, md_slider_2])
panel_11 = Panel(pt_8)
cyl_3 = Cylinder(Base=pt_8, Radius=num_2, Length=5)
cap_2 = CapHoles(Brep=cyl_3)

dt = Slider(0.08, range=0.01..0.1)
preview_17 = CustomPreview(
    Geometry=[box_3, cyl, cap, cap_2],
    Material={diffuse=RGB(128, 128, 128), emission=RGB(76, 76, 76), shine=0.5, specular=RGB(255, 255, 255), transparency=0.6})
python_7 = GhPythonScript(
    world_dt=dt,
    brick_pos=python_3,
    brick_rot=python_4,
    brick_type=python_5,
    t=Slider(1, range=0..1),
    dock_pos=panel_9,
    dock_rot=repeat_3,
    supply_pos=panel_10,
    supply_rot=repeat_5,
    supply_type=repeat_4,
    threat_pos=panel_11,
    threat_size=num_2)  # -> out; inputs dock_pos: list, dock_rot: list, supply_pos: list, supply_rot: list, supply_type: list, threat_pos: list, threat_size: list
# ---------- python_7: Python ----------
import uuid
import json
import math


def dist2d(pos1, pos2):
    return math.sqrt((pos1[0]-pos2[0])**2 + (pos1[1]-pos2[1])**2)

brick_pos = json.loads(brick_pos)
brick_rot = json.loads(brick_rot)
brick_type = json.loads(brick_type)
bricks = []

c = 0
for i in range(len(brick_pos)):
    row_bricks = []
    for j in range(len(brick_pos[i])):
        dids = []
        if i > 0:
            for k in range(len(brick_pos[i-1])):
                if dist2d(brick_pos[i-1][k], brick_pos[i][j]) <= t:
                    dids.append(bricks[-1][k]["id"])
#                    dids.append((i-1)*len(brick_pos[0]) + k)
        if j % 2:
            dids.append(c-1)
            if j+1 < len(brick_pos[i]):
                dids.append(c+1)
        row_bricks.append({"id": c,
                           "pos": brick_pos[i][j],
                           "rot": brick_rot[i][j],
                           "dids": dids,
                           "type": brick_type[i][j]})
        c += 1
    bricks.append(row_bricks)


#dock_pos = json.loads(dock_pos)
#dock_rot = json.loads(dock_rot)
dock_pos = [[float(_p.strip()) for _p in p[1:-1].split(',')] for p in dock_pos]

docks = []

for i in range(len(dock_pos)):
    docks.append({"id": i,
                  "pos": dock_pos[i],
                  "rot": dock_rot[i]})

supply_pos = [[float(_p.strip()) for _p in p[1:-1].split(',')] for p in supply_pos]
supplies = []
for i in range(len(supply_pos)):
    supplies.append({"id": i,
                     "pos": supply_pos[i],
                     "rot": supply_rot[i],
                     "type": int(supply_type[i])})

threat_pos = [[float(_p.strip()) for _p in p[1:-1].split(',')] for p in threat_pos]
threats = []
for i in range(len(threat_pos)):
    threats.append({"id": i,
                    "pos": threat_pos[i],
                    "size": threat_size[i]})

world = {"dt": world_dt}
print(world)

out = json.dumps({'bricks': bricks,
                  'docks': docks,
                  'supplies': supplies,
                  'threats': threats,
                  'world': world})
# ---------- end python_7 ----------
python_8 = GhPythonScript(
    world_dt=dt,
    spray_pos=facen_2.Centers,
    spray_rot=mod,
    dock_pos=panel_9,
    dock_rot=repeat_3,
    supply_pos=panel_10,
    supply_rot=repeat_5,
    supply_type=repeat_4,
    threat_pos=panel_11,
    threat_size=num_2)  # -> out; inputs spray_pos: list of Point3d, spray_rot: list, dock_pos: list, dock_rot: list, supply_pos: list, supply_rot: list, supply_type: list, threat_pos: list, threat_size: list
# ---------- python_8: Python ----------
import json
import math


def dist2d(pos1, pos2):
    return math.sqrt((pos1[0]-pos2[0])**2 + (pos1[1]-pos2[1])**2)


sprays = []

for i, p in enumerate(spray_pos):
    sprays.append({"id": i,
                   "pos": [p.X, p.Y, p.Z],
                   "rot": spray_rot[i]})
#                   "bricks": brick_indices[i]})

dock_pos = [[float(_p.strip()) for _p in p[1:-1].split(',')] for p in dock_pos]

docks = []

for i in range(len(dock_pos)):
    docks.append({"id": i,
                  "pos": dock_pos[i],
                  "rot": dock_rot[i]})

supply_pos = [[float(_p.strip()) for _p in p[1:-1].split(',')] for p in supply_pos]
supplies = []
for i in range(len(supply_pos)):
    supplies.append({"id": i,
                     "pos": supply_pos[i],
                     "rot": supply_rot[i],
                     "type": int(supply_type[i])})

threat_pos = [[float(_p.strip()) for _p in p[1:-1].split(',')] for p in threat_pos]
threats = []
for i in range(len(threat_pos)):
    threats.append({"id": i,
                    "pos": threat_pos[i],
                    "size": threat_size[i]})

world = {"dt": world_dt}
print(world)

out = json.dumps({'sprays': sprays,
                  'docks': docks,
                  'supplies': supplies,
                  'threats': threats,
                  'world': world})
# ---------- end python_8 ----------
panel_12 = Panel(python_7)
panel_13 = Panel(python_8)

# ==== cluster Cluster
pt = ClusterInput()
pt_2 = Point(pt)
G = ClusterInput()
move = Move(Geometry=G, Motion=pt_2)  # -> Geometry, Transform
A = ClusterInput()
xy = XYPlane(Origin=pt_2)
rotate = Rotate(Geometry=move.Geometry, Angle=A, Plane=xy)  # -> Geometry, Transform
G_2 = ClusterOutput(rotate.Geometry)
